# Grasshopper definition full toolkit.gh (Grasshopper 1.0.7)
# plug-ins: ElkGHComponents, Hops, Human, LunchBox

# ----
# Rhino Importer
layer_names = Panel("""1+1
2+2
2
3""")
panel = Panel("""[{"type":"parking","width":2,"fwd":true,"speed":14},{"type":"carriageway","width":3,"fwd":false,"speed":14},{"type":"carriageway","width":3,"fwd":true,"speed":14},{"type":"parking","width":2,"fwd":true,"speed":14}]
[{"type":"carriageway","width":3,"fwd":false,"speed":16.667},{"type":"carriageway","width":3,"fwd":false,"speed":16.667},{"type":"median","width":2.5,"fwd":true,"speed":14},{"type":"carriageway","width":3,"fwd":true,"speed":16.667},{"type":"carriageway","width":3,"fwd":true,"speed":16.667}]
[{"type":"carriageway","width":3,"fwd":true,"speed":14},{"type":"carriageway","width":3,"fwd":true,"speed":14}]
[{"type":"carriageway","width":3,"fwd":false,"speed":27.778},{"type":"carriageway","width":3,"fwd":true,"speed":27.778}]""")
load = Button()
not = GateNot(A=load)
item = ListItem(List=layer_names, Index=0, Wrap=False)  # -> Item, Item1, Item2, Item3
layer_ref = LayerReference(ReferenceToggle=not, LayerName=item.Item3)  # -> Geometry, Name, UserStrings, GUID
layer_ref_2 = LayerReference(ReferenceToggle=not, LayerName=item.Item2)  # -> Geometry, Name, UserStrings, GUID
layer_ref_3 = LayerReference(ReferenceToggle=not, LayerName=item.Item)  # -> Geometry, Name, UserStrings, GUID
layer_ref_4 = LayerReference(ReferenceToggle=not, LayerName=item.Item1)  # -> Geometry, Name, UserStrings, GUID
entwine = Entwine(
    Branch00=layer_ref_3.Geometry,
    Branch01=layer_ref_4.Geometry,
    Branch02=layer_ref_2.Geometry,
    Branch03=layer_ref.Geometry,
    FlattenInputs=True)
lng = ListLength(List=entwine)
topoly = CurveToPolyline(Curve=entwine, ToleranceDistance=0, ToleranceAngle=degrees(5))  # -> Polyline, Segments
repeat = RepeatData(Data=graft(panel), Length=lng)
trim = TrimTree(Tree=topoly.Polyline, Depth=1)
trim_2 = TrimTree(Tree=repeat, Depth=2)
rhinotonetwork = RhinoToNetwork(join_similar=Toggle(False), crv=trim, lanes=trim_2)

# ----
# OSM importer (elk)
path = FilePath("C:\Users\Atlas\Documents\. Research project\osm\strathfield.osm")
path_2 = FilePath("C:\Users\Atlas\Documents\. Research project\osm\mascot.osm")
path_3 = FilePath("C:\Users\Atlas\Documents\. Research project\osm\five dock.osm")
loc = Location(FilePathText=path_2)  # -> OSMPointData, OSMFile, LongitudeDomain, LatitudeDomain
osm = OSMData(OSMPointData=loc.OSMPointData, OSMFilePath=loc.OSMFile, Feature="highway", Generate3d=False, IndividualOutputs=False)  # -> Ways, FeatureKey
path_mapper = PathMapper(osm.FeatureKey, source="{A;B}", target="{0;A}")
path_mapper_2 = PathMapper(osm.Ways, source="{A;B}", target="{0;A}")
elktonetwork = ElkToNetwork(driving_right=Toggle(False), ways=path_mapper_2, keys=path_mapper)

# ----
# Extras
info = Hops(
    CacheResultsInMemory=True,
    CacheSolveResults=True,
    RemoteDefinitionLocation="http://127.0.0.1:5000/",
    RemoteSolveVersion=(0, 1, 0),
    ShowInput_Enabled=False,
    ShowInput_Path=False,
    SynchronousSolve=True)  # -> Details, Components
panel_2 = Panel(info.Components)

# ----
# Preview OSM
osm_2 = Data(loc.OSMPointData)
file = Data(loc.OSMFile)
osm_3 = OSMData(OSMPointData=osm_2, OSMFilePath=file, Feature="landuse", Generate3d=False, IndividualOutputs=False)  # -> Ways, FeatureKey
osm_4 = OSMData(OSMPointData=osm_2, OSMFilePath=file, Feature="building", Generate3d=False, IndividualOutputs=False)  # -> Ways, FeatureKey
osm_5 = OSMData(OSMPointData=osm_2, OSMFilePath=file, Feature="highway", Generate3d=False, IndividualOutputs=False)  # -> Ways, FeatureKey
pline = PolyLine(Vertices=osm_3.Ways, Closed=False)
pline_2 = PolyLine(Vertices=osm_4.Ways, Closed=False)
pline_3 = PolyLine(Vertices=osm_5.Ways, Closed=False)
boundary = BoundarySurfaces(Edges=pline)
boundary_2 = BoundarySurfaces(Edges=pline_2)
Z = UnitZ(Factor=4)
item_2 = ListItem(List=boundary, Index=0, Wrap=False)  # -> flatten(Item)
previewlw = CustomPreviewLineweights(Geometry=pline_3, Shader=ColourSwatch(SwatchColor=RGB(255, 238, 0)), Thickness=2, Absolute=False)
Z_2 = UnitZ(Factor=-0.1)
extr = Extrude(Base=boundary_2, Direction=Z)
move = Move(Geometry=item_2, Motion=Z_2)  # -> Geometry, Transform
preview = CustomPreview(Geometry=extr, Material=ColourSwatch(SwatchColor=RGB(150, 137, 104)))
preview_2 = CustomPreview(Geometry=move.Geometry, Material=ColourSwatch(SwatchColor=RGBA(204, 204, 198, 112)))

getkeys = GhPythonScript()  # -> S
# ---------- getkeys: Python ----------
"""Preview JSON data structure
    Inputs:
        JSON: JSON data as string
    Output:
        S: Structure"""

__author__ = "Atlas"
__version__ = "2023.07.29"

import rhinoscriptsyntax as rs
import json



def get_data(data, level=0):
    indent = '  '*(level)
    
    if isinstance(data, dict):
        if len(data) == 0:
            return '[]'
        
        expandable = False
        # determine if the dict is worth expanding (contains extra objects)
        for item in data.items():
            if isinstance(item[1], dict) or isinstance(item[1], list):
                expandable = True
                break # found something to expand
        
        if expandable:
            result = []
            for key, value in data.items():
                result.append("{0}:{1}".format(key, get_data(value, level+1)))
            
            return indent+'{\n'+indent+'  '+str((",\n"+indent+'  ').join(result))+'\n'+indent+'}'
        
        return '{'+str(len(data))+' items}'
    elif isinstance(data, list):
        if len(data) == 0:
            return '[]'
        
        if isinstance(data[0], dict) or isinstance(data[0], list):
            result = []
            i = 0
            for item in data:
                result.append(get_data(item, level+1))
                i += 1
                if i > 0:
                    result.append('...')
                    break
            return "[\n{1}{0}\n{1}]".format(", ".join(result), indent)
        
        return "[{0} items]".format(len(data))
    else:
        return str(type(data).__name__)

if JSON is not None:
    object = json.loads(JSON)
    S = get_data(object)
    #print(get_data([1,2,3,4]))

    print(object.keys())
# ---------- end getkeys ----------
info_2 = GhPythonScript()  # -> I
# ---------- info_2: Python ----------
"""Get info
    Inputs:
        Network: Road Network as JSON
    Output:
        I: Info"""

__author__ = "Atlas"
__version__ = "2023.07.29"

import rhinoscriptsyntax as rs
import json 

if Network is not None:
    info = json.loads(Network)['info']
    I = json.dumps(info, indent=2)
# ---------- end info_2 ----------
panel_3 = Panel(getkeys)
panel_4 = Panel(info_2)

# ---- group: Save network to file
path_4 = FilePath()
save = GhPythonScript(path=path_4, name="export.json", run=Button())  # inputs run: Boolean
# ---------- save: Python ----------
"""Save file to a location.
    Inputs:
        path: Directory
        name: File name and extension
        data: Data
        run: Set to True to run
    Output:
        a: The a output variable"""

__author__ = "Atlas"
__version__ = "2023.07.16"

import rhinoscriptsyntax as rs

if run:
    with open(path+name, 'w') as f:
        f.write(data)
    print('saved')
else:
    print('disabled')
# ---------- end save ----------

# ---- group: Import network from file
path_5 = FilePath()
# HOPS NOTICE: This script requires Hops. A server must be running with it and be able to send and receive data from it.
# 
# * Please note that the components may stop working after loading the file with them in it. Ensure the server is running already.
# 
# * Be aware of caching. It might be better to disable it. I also recommend enabling async to prevent locking up the script.
load_2 = GhPythonScript(path=path_5, run=Button())  # -> file; inputs run: Boolean
# ---------- load_2: Python ----------
"""Generic File loader
    Inputs:
        directory: Directory
        name: File name
        path: File path
        run: Set True to run
    Output:
        file: File data"""

__author__ = "Atlas"
__version__ = "2023.07.16"

import rhinoscriptsyntax as rs

if run:
    with open(path) as f:
        file = f.read()
    print('run')
else:
    print('disabled')
# ---------- end load_2 ----------

# ----
trim_3 = Hops(
    Network=elktonetwork,
    CornerRadius=2,
    CacheResultsInMemory=False,
    CacheSolveResults=False,
    RemoteDefinitionLocation="http://127.0.0.1:5000/trim",
    RemoteSolveVersion=(0, 1, 0),
    ShowInput_Enabled=False,
    ShowInput_Path=False,
    SynchronousSolve=True)

# ---- group: Add markers
panel_5 = Panel("""2
3""")
spawner = Spawner(road_index="84", lane_indices=panel_5, t="0.5", spacing="15", target="40")
addmarkers = Hops(
    Markers=spawner,
    CacheResultsInMemory=False,
    CacheSolveResults=False,
    RemoteDefinitionLocation="http://127.0.0.1:5000/add_markers",
    RemoteSolveVersion=(0, 1, 0),
    ShowInput_Enabled=False,
    ShowInput_Path=False,
    SynchronousSolve=True)

# ----
# Info: Inputs and outputs named `Network` all contain the same format of JSON and are all compatible with each other.
# 
# It is however recommended to generate the network, trim, and then run that data through whatever is needed.
dependencies = Panel("""Hops
Elk
Human
LunchBox""")

# ---- group: Add random traffic
randomtraffic = Hops(
    Network=trim_3,
    Count="100",
    Seed=0,
    CacheResultsInMemory=False,
    CacheSolveResults=False,
    RemoteDefinitionLocation="http://127.0.0.1:5000/random_traffic",
    RemoteSolveVersion=(0, 1, 0),
    ShowInput_Enabled=False,
    ShowInput_Path=False,
    SynchronousSolve=True)

# ---- group: Add vehicles
addvehicles = Hops(
    CacheResultsInMemory=True,
    CacheSolveResults=True,
    RemoteDefinitionLocation="http://127.0.0.1:5000/add_vehicles",
    RemoteSolveVersion=(0, 1, 0),
    ShowInput_Enabled=False,
    ShowInput_Path=False,
    SynchronousSolve=True)

# ----
network = Data(randomtraffic)

# ---- group: SIMULATION / RUN
dam = DataDam(DataA=network, BufferDelay=10000000, BufferMode=0)

# ---- group: SIMULATION
simparams = GhPythonScript(run=Toggle(True), duration=Slider(300, range=20..300), timestep=0.2)  # -> SP; inputs run: Boolean, save_skip: Int32
# ---------- simparams: Python ----------
"""Simulation Parameters
    Inputs:
        run: Set to True to run
        duration: Duration
        timestep: Timestep (dt)
        save_skip: Save frame skip
        timeout: Maximum simulation computation timeout in seconds
    Output:
        SP: Simulation Parameters"""

__author__ = "Atlas"
__version__ = "2023.07.28"

import json

def get(var, name):
    if var:
        data[name] = var


if run:
    data = {}
    
    get(duration, 'duration')
    get(timestep, 'timestep')
    get(save_skip, 'save_skip')
    get(timeout, 'timeout')
    
    # save
    SP = json.dumps(data)
# ---------- end simparams ----------
simulation = Hops(
    Network=dam,
    SimulationParameters=simparams,
    Seed=0,
    CacheResultsInMemory=False,
    CacheSolveResults=False,
    RemoteDefinitionLocation="http://127.0.0.1:5000/simulation",
    RemoteSolveVersion=(0, 1, 0),
    ShowInput_Enabled=False,
    ShowInput_Path=False,
    SynchronousSolve=False)  # -> Statistics, Animation, Analysis

# ---- group: Convert JSON into geometry
jsonnetworkgen = GhPythonScript(Network=network)  # -> Nodes, Curves, Roads, Markers
# ---------- jsonnetworkgen: Python ----------
"""Load JSON network and generate base curves and data.
    Inputs:
        Network: Road network as JSON
    Output:
        N: Nodes
        C: Curves
        R: Road attribute data"""

__author__ = "Atlas"
__version__ = "2023.07.13"

import rhinoscriptsyntax as rs
import json
import ghpythonlib.components as ghc

def pt(x, y=None):
    if y == None:
        return ghc.ConstructPoint(x[0],x[1],0)
    return ghc.ConstructPoint(x,y,0)

network = json.loads(Network)

output_nodes = []
output_curves = []
output_roads = []
output_markers = []


for node in network['nodes']:
    output_nodes.append(pt(node['x'],node['y']))


for road in network['roads']:
    crv = road['curve']
    if crv['crv_type'] == 'QBezier':
        output_curves.append(ghc.NurbsCurve(
            [pt(crv['n1']),pt(crv['cp']),pt(crv['n2'])], 
            2,
            False,
        )[0])
    
    elif crv['crv_type'] == 'Line':
        output_curves.append(ghc.Line(pt(crv['n1']),pt(crv['n2'])))
    
    elif crv['crv_type'] == 'PolyLine':
        output_curves.append(ghc.PolyLine([pt(p) for p in crv['pts']], False))
        
    output_roads.append(road)


for marker in network['markers']:
    #print(marker)
    output_markers.append(marker['road_index'])


Nodes = output_nodes
Curves = output_curves
Roads = output_roads
Markers = output_markers
# ---------- end jsonnetworkgen ----------

# ----
network_2 = Data(network)

# ----
# Choose vehicle model
model = ValueList({"None": -1, "Orient": 0, "Low poly": 1, "High poly": 2}, selected="Low poly")
car_low_poly = Geometry(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)
orient = Geometry(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)
car = Geometry(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)
move_2 = Move(Geometry=car, Motion=Vector(0, -1, 0))  # -> Geometry, Transform
scale = Scale(Geometry=orient, Center=Point(0, 0, 0), Factor=2)  # -> Geometry, Transform
move_3 = Move(Geometry=car_low_poly, Motion=Vector(0, -1, 0))  # -> Geometry, Transform
filter = StreamFilter(Gate=model, Stream0=scale.Geometry, Stream1=move_3.Geometry, Stream2=move_2.Geometry)

# ----
# Network viewer
laneoffsets = GhPythonScript(roads=jsonnetworkgen.Roads)  # -> O, D, Fwd
# ---------- laneoffsets: Python ----------
"""Provides a scripting component.
    Inputs:
        x: The x script variable
        y: The y script variable
    Output:
        O: Offsets
        D: Domains
        Fwd: True if forward (aligned with curve direction)"""

__author__ = "Atlas"
__version__ = "2023.07.13"

import rhinoscriptsyntax as rs
import ghpythonlib.components as ghc

#import Grasshopper.DataTree as DataTree
#import Grasshopper.Kernel.Data.GH_Path as ghpath
#D = DataTree[object]()


def map_range(value, value_domain=(0,1), output_domain=(0,1), clamp=False):
    """Map a value from an input range into an output range. Ranges may be a tuple or a number signifying the maxima."""

    if not isinstance(value_domain, tuple):
        value_domain = (0, value_domain-1)
    if not isinstance(output_domain, tuple):
        output_domain = (0, output_domain-1)

    if clamp:
        value = max(min(value, value_domain[1]), value_domain[0])
    
    if value_domain[1] - value_domain[0] == 0:
        return output_domain[0] # prevent division by 0 when mapping from a domain range of 0
    
    return output_domain[0] + (output_domain[1]-output_domain[0]) * ((value-value_domain[0])/(value_domain[1]-value_domain[0]))


def lerp(t, bounds):
    return bounds[0] + t*(bounds[1]-bounds[0])

#print(roads['trim_dist_start'])
#print(roads['trim_dist_end'])

total_width = 0 
cumulative_offset = [0] # 0+ for offset
output_fwd = []
for lane in roads['lanes']:
    if 'width' in lane:
        total_width += lane['width']
    else:
        total_width += 3
    cumulative_offset.append(total_width)
    
    output_fwd.append(lane['fwd'])

if total_width > 0:
    
    start_offset = (total_width/-2)
    #print(total_width)
    #print(start_offset)
    
    output_offsets = []
    output_subcurve_domains = []
    for offset in cumulative_offset:
        #print(offset)
        output_offsets.append(start_offset + offset)
        output_subcurve_domains.append(
            ghc.ConstructDomain(
                lerp(offset/total_width, roads.get('trim_dist_start',(0,0))), 
                lerp(offset/total_width, roads.get('trim_dist_end',(0,0)))
                )
            )
        
    O = output_offsets
    D = output_subcurve_domains
    
else:
    O = [None]
    D = [None]
    
    print('No width found, probably lacking lane data')

Fwd = output_fwd
# ---------- end laneoffsets ----------
crvs = Curve(jsonnetworkgen.Curves)
offset = OffsetCurve(Curve=graft(crvs), Distance=laneoffsets.O, Plane=PlaneXY(0, 0, 0), Corners=1)
dedom = DeconstructDomain(Domain=laneoffsets.D)  # -> Start, End
trim_4 = TrimTree(Tree=offset, Depth=1)
neg = Negative(Value=dedom.End)
neg_2 = Negative(Value=dedom.Start)
ext = ExtendCurve(Curve=trim_4, Type=0, Start=neg_2, End=neg)
spans = RoadSpans(L=ext)
preview_3 = CustomPreview(Geometry=spans, Material=ColourSwatch(SwatchColor=RGB(69, 69, 69)))
previewlw_2 = CustomPreviewLineweights(Geometry=ext, Shader=ColourSwatch(SwatchColor=RGB(69, 56, 56)), Thickness=2, Absolute=False)

# ----
# Fillets
fillets = Hops(
    Network=network_2,
    CacheResultsInMemory=False,
    CacheSolveResults=False,
    RemoteDefinitionLocation="http://127.0.0.1:5000/fillets",
    RemoteSolveVersion=(0, 1, 0),
    ShowInput_Enabled=False,
    ShowInput_Path=False,
    SynchronousSolve=True)
constructcrvs = GhPythonScript(Data=fillets)  # -> C
# ---------- constructcrvs: Python ----------
"""Create curve geometry from JSON data
    Inputs:
        Data: Data
    Output:
        C: Curves"""

__author__ = "Atlas"
__version__ = "2023.07.29"

import rhinoscriptsyntax as rs
import ghpythonlib.components as ghc
import json

def pt(coords):
    return ghc.ConstructPoint(coords[0], coords[1], 0)

output_curves = []

for fillet in json.loads(Data):
    
    if fillet['crv_type'] == 'Line':
        output_curves.append(ghc.Line(pt(fillet['n1']), pt(fillet['n2'])))
    
    elif fillet['crv_type'] == 'QBezier':
        output_curves.append(ghc.NurbsCurve([pt(fillet['n1']), pt(fillet['cp']), pt(fillet['n2'])], 2, False)[0])
    
    elif fillet['crv_type'] == 'PolyLine':
        output_curves.append(PolyLine([pt(x) for x in fillet['pts']], False))
    
    elif fillet['crv_type'] == 'Circle':
        output_curves.append(Circle(pt(fillet['center_pt']), fillet['radius']))

C = output_curves
# ---------- end constructcrvs ----------
previewlw_3 = CustomPreviewLineweights(Geometry=constructcrvs, Shader=ColourSwatch(SwatchColor=RGB(61, 61, 61)), Thickness=2, Absolute=False)

# ----
# Preview indices
toggle = BooleanToggle(False)
nodes = Point(jsonnetworkgen.Nodes)
crvs_2 = Curve(jsonnetworkgen.Curves)
gate = StreamGate(Stream=crvs_2, Gate=toggle)  # -> Target0, Target1
gate_2 = StreamGate(Stream=nodes, Gate=toggle)  # -> Target0, Target1
eval = EvaluateLength(Curve=gate.Target1, Length=0.5, Normalized=True)  # -> Point, Tangent, Parameter
lng_2 = ListLength(List=gate.Target1)
lng_3 = ListLength(List=gate_2.Target1)
series = Series(Start=0, Step=1, Count=lng_2)
series_2 = Series(Start=0, Step=1, Count=lng_3)
tag = TextTag(Location=eval.Point, Text=series, Colour=ColourSwatch(SwatchColor=RGB(255, 255, 255)))
tag_2 = TextTag(Location=gate_2.Target1, Text=series_2, Colour=ColourSwatch(SwatchColor=RGB(0, 255, 200)))
amp = Amplitude(Vector=eval.Tangent, Amplitude=10)
vdisex = VectorDisplayEx(Point=eval.Point, Vector=amp, Colour=ColourSwatch(SwatchColor=RGB(255, 0, 0)), Width=2)

# ----
# Preview lane mapping
toggle_2 = BooleanToggle(False)
network_3 = Data(network_2)
gate_3 = StreamGate(Stream=network_3, Gate=toggle_2)  # -> Target0, Target1
hops = Hops(
    Network=gate_3.Target1,
    CacheResultsInMemory=False,
    CacheSolveResults=False,
    RemoteDefinitionLocation="http://127.0.0.1:5000/mapping_curves",
    RemoteSolveVersion=(0, 1, 0),
    ShowInput_Enabled=False,
    ShowInput_Path=False,
    SynchronousSolve=True)
jsoncrv = GhPythonScript(JSON=hops)  # -> Crv
# ---------- jsoncrv: Python ----------
"""Generate curves from JSON data
    Inputs:
        JSON: JSON data (should specify `crv_type`, among other things)
    Output:
        Crv: Curve"""

__author__ = "Atlas"
__version__ = "2023.08.11"

import rhinoscriptsyntax as rs
import ghpythonlib.components as ghc
import json

def pt(x, y=None):
    if y == None:
        return ghc.ConstructPoint(x[0],x[1],0)
    return ghc.ConstructPoint(x,y,0)

output_curves = []

loaded_json = json.loads(JSON)
if not isinstance(loaded_json, list):
    loaded_json = [loaded_json]

for crv in loaded_json:
    if crv['crv_type'] == 'QBezier':
        output_curves.append(ghc.NurbsCurve(
            [pt(crv['n1']),pt(crv['cp']),pt(crv['n2'])], 
            2,
            False,
        )[0])
    
    elif crv['crv_type'] == 'Line':
        output_curves.append(ghc.Line(pt(crv['n1']),pt(crv['n2'])))
    
    elif crv['crv_type'] == 'PolyLine':
        output_curves.append(ghc.PolyLine([pt(p) for p in crv['pts']], False))
    
Crv = output_curves
# ---------- end jsoncrv ----------
cdiv = Derivatives(Curve=reparameterize(jsoncrv), Parameter=0.5)  # -> Point, FirstDerivative, SecondDerivative
amp_2 = Amplitude(Vector=cdiv.SecondDerivative, Amplitude=Slider(0.27, range=0..1))
move_4 = Move(Geometry=jsoncrv, Motion=amp_2)  # -> Geometry, Transform
lng_4 = ListLength(List=move_4.Geometry)
series_3 = Series(Start=0, Step=1, Count=lng_4)
eval_2 = EvaluateCurve(Curve=reparameterize(move_4.Geometry), Parameter=1)  # -> Point, Tangent, Angle
division = Division(A=series_3, B=lng_4)
amp_3 = Amplitude(Vector=eval_2.Tangent, Amplitude=4)
multiplication = Multiplication(A=division, B=0.8)
hsv = ColourHSV(Alpha=1, Hue=multiplication, Saturation=1, Value=1)
vdisex_2 = VectorDisplayEx(Point=eval_2.Point, Vector=amp_3, Colour=hsv, Width="4")
previewlw_4 = CustomPreviewLineweights(Geometry=move_4.Geometry, Shader=hsv, Thickness="4", Absolute=False)

# ----
# Pathfind example
number_slider = Slider(9, range=0..100)
crvs_3 = Curve(jsonnetworkgen.Curves)
network_4 = Data(network_2)
gate_4 = StreamGate(Stream=network_4, Gate=Toggle(False))  # -> Target0, Target1
pathfind = Hops(
    Network=gate_4.Target1,
    StartRoadIndex=number_slider,
    StartLaneIndex=Slider(1, range=0..6),
    EndRoadIndex=Slider(18, range=0..100),
    EndLaneIndex=-1,
    DepthLimit=Slider(100, range=0..100),
    CacheResultsInMemory=False,
    CacheSolveResults=False,
    RemoteDefinitionLocation="http://127.0.0.1:5000/pathfind",
    RemoteSolveVersion=(0, 1, 0),
    ShowInput_Enabled=False,
    ShowInput_Path=False,
    SynchronousSolve=True)
json = GhPythonScript(route=pathfind)  # -> RI, LI
# ---------- json: Python ----------
__author__ = "Atlas"
__version__ = "2023.07.26"

import rhinoscriptsyntax as rs
import json

data = json.loads(route)

RI = []
LI = []
for elem in data:
    RI.append(elem[0])
    LI.append(elem[1])
# ---------- end json ----------
item_3 = ListItem(List=crvs_3, Index=json.RI, Wrap=False)
previewlw_5 = CustomPreviewLineweights(Geometry=item_3, Shader=ColourSwatch(SwatchColor=RGB(255, 0, 200)), Thickness=10, Absolute=False)

# ----
# Animation viewer
toggle_3 = BooleanToggle(True)
car_model = Geometry(filter)
animation = Data(simulation.Animation)
gate_5 = StreamGate(Stream=animation, Gate=toggle_3)  # -> Target0, Target1
animload = GhPythonScript(Animation=gate_5.Target1)  # -> info, anim
# ---------- animload: Python ----------
"""Load animation
    Inputs:
        Run: Set to True to run
        Animation: Animation
    Output:
        info: Information related to the animation
        anim: Animation data for Python"""

__author__ = "Atlas"
__version__ = "2023.07.13"

import rhinoscriptsyntax as rs
import ghpythonlib.components as ghc
import json


animation = json.loads(Animation)
#print(animation[0])
anim = animation['vehicles']
animation.pop('vehicles')

info = [animation]
# ---------- end animload ----------
anim = GhPythonScript(info=animload.info, anim=animload.anim, time=Slider(0, range=0..300))  # -> P, B; inputs anim: list
# ---------- anim: Python ----------
"""Provides a scripting component.
    Inputs:
        anim: Animation
        time: Current time
        object: Object to instance at vehicles
    Output:
        P: Vehicle positions
        B: Vehicle bearing"""

__author__ = "Atlas"
__version__ = "2023.07.13"

import rhinoscriptsyntax as rs
import ghpythonlib.components as ghc
import math

output_pos = []
output_bearing = []

anim_t = time / info['duration_sec']
index = time / info['animation_timestep']
t = index % 1
index = int(math.floor(index))

print(anim_t)
print(index, t)

for vehicle in anim:
    va = vehicle['animation']
    veh_index = int(math.floor(va[0][0] / info['animation_timestep']))
    actual_index = index-veh_index
    print('actual', actual_index)
    
    try:
        if actual_index < len(va) and actual_index >= 0: # consider that vehicle spawn times are different
            
            #print('')
            frame0 = va[actual_index]
            frame1 = va[actual_index+1]
            
            pos_x = frame0[1] + t*(frame1[1]-frame0[1])
            pos_y = frame0[2] + t*(frame1[2]-frame0[2])
            
            bearing_diff = (frame1[3]-frame0[3] + 180)%360-180
            bearing = frame0[3] + t*bearing_diff#(frame1[3]-frame0[3])
            
            output_pos.append(ghc.ConstructPoint(pos_x, pos_y, 0))
            output_bearing.append(bearing)
        else:
            print('out of range')
    except:
        pass
P = output_pos
B = output_bearing
# ---------- end anim ----------
subtraction = Subtraction(A=180, B=anim.B)
rotate = Rotate(Geometry=car_model, Angle=degrees(subtraction), Plane=PlaneXY(0, 0, 0))  # -> Geometry, Transform
move_5 = Move(Geometry=rotate.Geometry, Motion=anim.P)  # -> Geometry, Transform
geo = Geometry(move_5.Geometry)
lng_5 = ListLength(List=move_5.Geometry)
randcol = RandomColour(count=lng_5, seed=Slider(29, range=0..100))
preview_4 = CustomPreview(Geometry=geo, Material=randcol)

# ----
# Analysis
visualise = ValueList({"None": -1, "Occupancy": 0, "Average speed": 1}, selected="None")
analysis = Data(simulation.Analysis)
crvs_4 = Curve(jsonnetworkgen.Curves)
analysis_2 = GhPythonScript(data=analysis)  # -> O, S
# ---------- analysis_2: Python ----------
__author__ = "Atlas"
__version__ = "2023.07.20"

import rhinoscriptsyntax as rs
import json

loaded_data = json.loads(data)

O = loaded_data['occupancy_time_total']
S = loaded_data['avg_speed']
# ---------- end analysis_2 ----------
len = Length(Curve=crvs_4)
division_2 = Division(A=analysis_2.O, B=len)
filter_2 = StreamFilter(Gate=visualise, Stream0=division_2, Stream1=analysis_2.S)
bnd = Bounds(Numbers=filter_2)
dedom_2 = DeconstructDomain(Domain=bnd)  # -> Start, End
gradient = Gradient(
    LowerLimit=dedom_2.Start,
    UpperLimit=dedom_2.End,
    Parameter=filter_2,
    stops=[0.151: RGB(0, 128, 128), 0.432: RGB(0, 192, 0), 0.763: RGB(255, 128, 0), 1: RGB(234, 38, 0)])
graft = GraftTree(Tree=gradient, IncludeEmptyLists=True, IncludeNullItems=True)
previewlw_6 = CustomPreviewLineweights(Geometry=crvs_4, Shader=gradient, Thickness=10, Absolute=False)
preview_5 = CustomPreview(Material=graft)  # disabled

# ---- group: srf
gate_6 = StreamGate(Stream=constructcrvs, Gate=Toggle(True))  # -> Target0, Target1
end = EndPoints(Curve=gate_6.Target1)  # -> Start, End
shift = ShiftList(List=end.Start, Shift=0, Wrap=True)
shift_2 = ShiftList(List=end.End, Shift=-1, Wrap=True)
ln = Line(StartPoint=shift, EndPoint=shift_2)
trim_5 = TrimTree(Tree=ln, Depth=1)
merge = Merge(Data1=gate_6.Target1, Data2=trim_5)
join = JoinCurves(Curves=merge, Preserve=False)
boundary_3 = BoundarySurfaces(Edges=join)
preview_6 = CustomPreview(Geometry=boundary_3, Material=ColourSwatch(SwatchColor=RGB(74, 74, 74)))

# ---- group: Lane vectors
lanevectors = LaneVectors(offsets=laneoffsets.O, crvs=crvs, fwd=laneoffsets.Fwd)  # -> pts_2, vectors_2
amp_4 = Amplitude(Vector=lanevectors.vectors_2, Amplitude=5)
move_6 = Move(Geometry=lanevectors.pts_2, Motion=Vector(0, 0, 1))  # -> Geometry, Transform
vdisex_3 = VectorDisplayEx(Point=move_6.Geometry, Vector=amp_4, Colour=ColourSwatch(SwatchColor=RGB(255, 255, 255)), Width=2)

# ==== cluster RandomColour: Generate random colours (HSV)
count = ClusterInput()
seed = ClusterInput()
count_2 = Integer(count)
seed_2 = Integer(seed)
random = Random(Range=Domain(0, 1), Number=count_2, Seed=expr("x+12", seed_2))  # disabled
random_2 = Random(Range="0.8 To 1", Number=count_2, Seed=expr("x+19", seed_2))
random_3 = Random(Range=Domain(0, 1), Number=count_2, Seed=seed_2)
hsv = ColourHSV(Alpha=1, Hue=random_3, Saturation=1, Value=random_2)
col = Colour(hsv)
col_2 = ClusterOutput(col)

# ==== cluster ElkToNetwork: Create a road network from Elk highway data (sourced from OSM)
driving_right = ClusterInput()
ways = ClusterInput()
keys = ClusterInput()
driving_right_2 = Boolean(driving_right)
ways_2 = Data(ways)
keys_2 = Data(keys)

# ---- group: useful elk data to json
getkeys = GhPythonScript(keys=keys_2)  # -> K; inputs keys: list
# ---------- getkeys: Python ----------
"""Get the keys from Elk-returned OSM data
    Inputs:
        keys: Keys as list
    Output:
        K: Processed keys"""

__author__ = "Atlas"
__version__ = "2023.07.16"

import rhinoscriptsyntax as rs
import json

data = {}
ALLOWED_KEYS = ['highway', 'name', 'maxspeed', 'lanes', 'oneway', 'width']

for key in keys:
    split_text = key.split(':')
    if len(split_text) == 2:
        if split_text[0] in ALLOWED_KEYS:
            #print(split_text)
            data[split_text[0]] = split_text[1]

K = json.dumps(data)
# ---------- end getkeys ----------

# ----
cset = CreateSet(List=flatten(getkeys))  # -> Set, Map; disabled
pline = PolyLine(Vertices=ways_2, Closed=False)
panel = Panel(cset.Set)

# ---- group: lanes, name - create intermediate format
filterkeys = GhPythonScript(driving_right=driving_right_2, geo=pline, keys=getkeys)  # -> G, ID
# ---------- filterkeys: Python ----------
"""Get curves and correct lane data.
    Inputs:
        driving_right: Whether vehicles travel on the right side of the road
        geo: Geometry passthrough
        keys: Keys as JSON
    Output:
        G: Geometry passthrough
        ID: Intermediate JSON
        """

__author__ = "Atlas"
__version__ = "2023.07.16"

import rhinoscriptsyntax as rs
import json


data = json.loads(keys)
intermediate = {} # usable by the road network system
lanes = [] # list of lanes
keep = False # whether to output the road


######################

def get(key, default):
    """Find key, otherwise return default."""
    if key in data:
        return data[key]
    else:
        return default

def kph(speed):
    """Convert km/h to m/s and round result."""
    return round(speed*0.277778, 3)

########################
try:
    if data['highway'] == 'motorway' or data['highway'] == 'trunk' or data['highway'] == 'motorway_link' or data['highway'] == 'trunk_link':
        lane_count = int(get('lanes', 2))
        speed_limit = kph(float(get('maxspeed', 100)))
        oneway = get('oneway', 'no') == 'yes'
        if oneway:
            for _ in range(lane_count):
                lanes.append({'type':'carriageway','fwd':True,'speed':speed_limit})
            keep = True
        
    elif data['highway'] == 'primary':
        lane_count = int(get('lanes', 2))
        speed_limit = kph(float(get('maxspeed', 100)))
        oneway = get('oneway', 'no') == 'yes'
        
        if oneway:
            for _ in range(lane_count):
                lanes.append({'type':'carriageway','fwd':True,'speed':speed_limit})
            keep = True
        else:
            for _ in range(lane_count // 2):
                lanes.append({'type':'carriageway','fwd':False,'speed':speed_limit})
            for _ in range(lane_count // 2):
                lanes.append({'type':'carriageway','fwd':True,'speed':speed_limit})
            keep = True
        
    elif data['highway'] == 'secondary':
        lane_count = int(get('lanes', 2))
        speed_limit = kph(float(get('maxspeed', 80)))
        oneway = get('oneway', 'no') == 'yes'
        
        if oneway:
            for _ in range(lane_count):
                lanes.append({'type':'carriageway','fwd':True,'speed':speed_limit})
            keep = True
        else:
            for _ in range(lane_count // 2):
                lanes.append({'type':'carriageway','fwd':False,'speed':speed_limit})
            for _ in range(lane_count // 2):
                lanes.append({'type':'carriageway','fwd':True,'speed':speed_limit})
            keep = True
    
    elif data['highway'] == 'tertiary':
        lane_count = int(get('lanes', 2))
        speed_limit = kph(float(get('maxspeed', 60)))
        oneway = get('oneway', 'no') == 'yes'
        
        if oneway:
            print('oneway t')
            for _ in range(lane_count):
                lanes.append({'type':'carriageway','fwd':True,'speed':speed_limit})
            keep = True
        else:
            for _ in range(lane_count // 2):
                lanes.append({'type':'carriageway','fwd':False,'speed':speed_limit})
            for _ in range(lane_count // 2):
                lanes.append({'type':'carriageway','fwd':True,'speed':speed_limit})
            keep = True
    
    elif data['highway'] == 'residential':
        lane_count = int(get('lanes', 2))
        speed_limit = kph(float(get('maxspeed', 50)))
        oneway = get('oneway', 'no') == 'yes'
        
        if oneway:
            print('oneway r')
            for _ in range(lane_count):
                lanes.append({'type':'carriageway','fwd':True,'speed':speed_limit})
            keep = True
        else:
            for _ in range(lane_count // 2):
                lanes.append({'type':'carriageway','fwd':False,'speed':speed_limit})
            for _ in range(lane_count // 2):
                lanes.append({'type':'carriageway','fwd':True,'speed':speed_limit})
            keep = True
    
    
    
    ################
    
    if keep:
        # add name if it exists
        if 'name' in data:
            intermediate['road_name'] = str(data['name'])
        
        # add hash to make comparisons easier for joining
        #intermediate['hash'] = hash(str(data))
        
        # add lanes
        if not driving_right:
            lanes = list(reversed(lanes))
        intermediate['lanes'] = lanes
        
        # save
        G = geo
        ID = json.dumps(intermediate)
except Exception as E:
    print E
# ---------- end filterkeys ----------

# ---- group: remove nulls and trim tree
cleanp = CleanParallel(PrimaryData=filterkeys.G, SecondaryData1=filterkeys.ID, removeEmpty=True, ValueTable_removeEmpty=False)  # -> PrimaryData, SecondaryData1
trim = TrimTree(Tree=cleanp.SecondaryData1, Depth=1)
trim_2 = TrimTree(Tree=cleanp.PrimaryData, Depth=1)

# ---- group: Join curves of matching data
cset_2 = CreateSet(List=trim)  # -> Set, Map
tree = GhPythonScript(list=trim_2, map=cset_2.Map)  # -> T; inputs list: list, map: list
# ---------- tree: Python ----------
"""Provides a scripting component.
    Inputs:
        list: List to map
        map: Map
    Output:
        T: The a output variable"""

__author__ = "Atlas"
__version__ = "2023.07.29"

import rhinoscriptsyntax as rs
import ghpythonlib.components as ghc
import Grasshopper.DataTree as DataTree
import Grasshopper.Kernel.Data.GH_Path as ghpath

assert len(map) == len(list)

T = DataTree[object]() 

for l, m in zip(list, map):
    T.Add(l, ghpath(0,m))
# ---------- end tree ----------
graft = GraftTree(Tree=cset_2.Set, IncludeEmptyLists=True, IncludeNullItems=True)
join = JoinCurves(Curves=tree, Preserve=False)
lng = ListLength(List=join)
repeat = RepeatData(Data=graft, Length=lng)

# ----
lng_2 = ListLength(List=cset_2.Map)
lng_3 = ListLength(List=cset_2.Set)
comparison_of_data_saving = Panel([lng_3, lng_2])
trim_3 = TrimTree(Tree=repeat, Depth=3)
trim_4 = TrimTree(Tree=join, Depth=2)
toggle = BooleanToggle(True)

# ---- group: join adjacent curves that match
filter = StreamFilter(Gate=toggle, Stream0=trim, Stream1=trim_3)
filter_2 = StreamFilter(Gate=toggle, Stream0=trim_2, Stream1=trim_4)

# ---- group: split curves that intersect
splitcrvs = GhPythonScript(curves=filter_2, attr=filter)  # -> S, A; inputs curves: list of Curve, attr: list
# ---------- splitcrvs: Python ----------
"""Splits curves where they intersect and output curve segments along with a passthrough attribute.
    Inputs:
        curves: Input road curves
        attr: Curve attributes
    Output:
        S: Shattered segments
        A: Attribute passthrough"""

__author__ = "MARTIN IBBETT"
__version__ = "2023.05.29"

import rhinoscriptsyntax as rs
import ghpythonlib.components as ghc
import Rhino.Geometry.Intersect as its

segments = []
attributes = []

if attr == []:
    attr = [None for _ in range(len(curves))]

# get curve intersections
_, iA, iB, tA, tB = ghc.MultipleCurves(curves)
curve_intersections = zip(iA, iB, tA, tB)

# iterate over every curve
for i, curve in enumerate(curves):
    split = [] # stores shatter locations for the curve
    
    # get all parameters from curve intersections
    for iA, iB, tA, tB in curve_intersections:
        if i == iA:
            split.append(tA)
        elif i == iB:
            split.append(tB)
    
    # find self intersections (note: uses Rhino rather than GH)
    #print(curve)
    for event in its.Intersection.CurveSelf(curve, 0.01):
        split.append(event.ParameterA)
        split.append(event.ParameterB)
    
    # add to segments list
    shattered = ghc.Shatter(curve, split)
    
    # add shattered segments to final output list
    if type(shattered) == type(segments):
        for s in shattered:
            segments.append(s)
            attributes.append(attr[i])
    else:
        # only a single item
        segments.append(shattered)
        attributes.append(attr[i])

# output for component
S = ghc.CleanTree(True, True, True, segments)
A = attributes
# ---------- end splitcrvs ----------

# ----
simplify = SimplifyCurve(Curve=splitcrvs.S, Tolerance=0.01)  # -> Curve, Simplified

# ---- group: overlapping curve end points
end = EndPoints(Curve=simplify.Curve)  # -> Start, End
merge = Merge(Data1=graft(end.Start), Data2=graft(end.End))
trim_5 = TrimTree(Tree=merge, Depth=1)
pt = Point(trim_5)
cullpt = CullDuplicates(Points=pt, Tolerance=1, CullMode=1)  # -> Points, Indices, Valence
cp = ClosestPoint(Point=graft(pt), Cloud=cullpt.Points)  # -> ClosestPoint, CPIndex, Distance
trim_6 = TrimTree(Tree=cp.CPIndex, Depth=1)
map = Integer(trim_6)
nodes = Point(cullpt.Points)

# ---- group: create network
createnetwork = GhPythonScript(nodes=nodes, map=map, curves=simplify.Curve, intermediate_data=splitcrvs.A)  # -> Network; inputs nodes: list of Point3d, map: list of Int32, curves: list of Curve, intermediate_data: list
# ---------- createnetwork: Python ----------
"""Make JSON data
    Inputs:
        x: The x script variable
        intermediate_data: intermediate_data
    Output:
        Network: Road Network as JSON data"""

__author__ = "Atlas"
__version__ = "2023.07.16"

import rhinoscriptsyntax as rs
import ghpythonlib.components as ghc
import Rhino.Geometry as rg
import json


def pt(point):
    return (point[0], point[1])

##############
output_nodes = []
for node in nodes:
    output_nodes.append({
        'x':round(node[0]),
        'y':round(node[1]),
        'z':round(node[2]),
        })
##############

##############
output_roads = []
i = 0
for curve, attribute in zip(curves, intermediate_data):
    if isinstance(curve, rg.LineCurve):
        #print('line')
        ends = ghc.EndPoints(curve)
        processed_curve = {'crv_type':'Line','n1':pt(ends[0]),'n2':pt(ends[1])}
    elif isinstance(curve, rg.PolylineCurve):
        #print('polyline')
        pts = ghc.ControlPoints(curve)[0]
        processed_curve = {'crv_type':'PolyLine','pts':[pt(p) for p in pts]}
    else:
        print(curve)
        raise Exception('curve type unsupported, only lines and polylines')
        #continue # unsupported curve type
    
    attribute = json.loads(attribute) # intermediate_data contains name and lanes

    n1 = map[i*2]
    n2 = map[i*2+1]
    attribute['n1'] = n1
    attribute['n2'] = n2
    attribute['curve'] = processed_curve
    attribute['trim_start'] = [0,0]
    attribute['trim_end'] = [1,1]
    
    output_roads.append(attribute)
    i += 1
##############

info = {
    'node_count':len(output_nodes),
    'road_count':len(output_roads),
    'properties':[]
}

Network = json.dumps({
    'info':info,
    'nodes':output_nodes, 
    'roads':output_roads,
    'markers':[],
    'vehicles':[],
})
# ---------- end createnetwork ----------

# ----
network = ClusterOutput(createnetwork)

# ==== cluster LaneVectors: Get the vectors of each lane.
fwd = ClusterInput()
crvs = ClusterInput()
offsets = ClusterInput()
fwd_2 = Boolean(fwd)
crvs_2 = Curve(crvs)
offsets_2 = Number(offsets)
shift = ShiftList(List=offsets_2, Shift=-1, Wrap=False)  # -> graft(List)
shift_2 = ShiftList(List=offsets_2, Shift=1, Wrap=False)  # -> graft(List)
eval = EvaluateLength(Curve=graft(crvs_2), Length=0.5, Normalized=True)  # -> Point, Tangent, Parameter
remap = RemapNumbers(Value=fwd_2, Source=Domain(0, 1), Target=Domain(-1, 1))  # -> Mapped, Clipped
avr = Average(Input=[shift, shift_2])
trim = TrimTree(Tree=avr, Depth=2)
Z = UnitZ(Factor=1)
xprod = CrossProduct(VectorA=eval.Tangent, VectorB=Z, Unitize=False)  # -> Vector, Length
multiplication = Multiplication(A=eval.Tangent, B=remap.Mapped)
multiplication_2 = Multiplication(A=trim, B=xprod.Vector)
move = Move(Geometry=eval.Point, Motion=multiplication_2)  # -> Geometry, Transform
pts = Point(move.Geometry)
vectors = Vector(multiplication)
pts_2 = ClusterOutput(pts)
vectors_2 = ClusterOutput(vectors)

# ==== cluster RoadSpans: Get span surfaces for each road using edge curves.
L = ClusterInput()
first_last = FirstLast(List=L)  # -> FirstValue, LastValue
merge = Merge(Data1=first_last.FirstValue, Data2=first_last.LastValue)
clean = CleanTree(RemoveNulls=True, RemoveInvalid=True, RemoveEmpty=True, Tree=merge)
loft = Loft(Curves=clean, Options={Adjust=False, Closed=False, LoftEnds=0, LoftSimp=0, LoftType=0, Rebuild=10, Refit=0.01})
L_2 = ClusterOutput(loft)

# ==== cluster RhinoToNetwork
lanes = ClusterInput()
join_similar = ClusterInput()
crv = ClusterInput()
lanes_2 = Data(lanes)
crv_2 = Curve(crv)
join_similar_2 = Boolean(join_similar)

# ---- group: remove nulls and trim tree
cleanp = CleanParallel(PrimaryData=crv_2, SecondaryData1=lanes_2, removeEmpty=True, ValueTable_removeEmpty=False)  # -> PrimaryData, SecondaryData1

# ---- group: Join curves of matching data
cset = CreateSet(List=cleanp.SecondaryData1)  # -> Set, Map
tree = GhPythonScript(list=cleanp.PrimaryData, map=cset.Map)  # -> T; inputs list: list, map: list; same code as tree
graft = GraftTree(Tree=cset.Set, IncludeEmptyLists=True, IncludeNullItems=True)
join = JoinCurves(Curves=tree, Preserve=False)
lng = ListLength(List=join)
repeat = RepeatData(Data=graft, Length=lng)

# ----
lng_2 = ListLength(List=cset.Map)
lng_3 = ListLength(List=cset.Set)
comparison_of_data_saving = Panel([lng_3, lng_2])
trim = TrimTree(Tree=repeat, Depth=3)
trim_2 = TrimTree(Tree=join, Depth=2)
toggle = BooleanToggle(False)
join_similar_3 = Boolean(join_similar_2)

# ---- group: join adjacent curves that match
filter = StreamFilter(Gate=join_similar_3, Stream0=cleanp.SecondaryData1, Stream1=trim)
filter_2 = StreamFilter(Gate=join_similar_3, Stream0=cleanp.PrimaryData, Stream1=trim_2)

# ---- group: split curves that intersect
splitcrvs = GhPythonScript(curves=filter_2, attr=filter)  # -> S, A; inputs curves: list of Curve, attr: list; same code as splitcrvs

# ----
simplify = SimplifyCurve(Curve=splitcrvs.S, Tolerance=0.01)  # -> Curve, Simplified

# ---- group: overlapping curve end points
end = EndPoints(Curve=simplify.Curve)  # -> Start, End
merge = Merge(Data1=graft(end.Start), Data2=graft(end.End))
trim_3 = TrimTree(Tree=merge, Depth=1)
pt = Point(trim_3)
cullpt = CullDuplicates(Points=pt, Tolerance=1, CullMode=1)  # -> Points, Indices, Valence
cp = ClosestPoint(Point=graft(pt), Cloud=cullpt.Points)  # -> ClosestPoint, CPIndex, Distance
trim_4 = TrimTree(Tree=cp.CPIndex, Depth=1)
map = Integer(trim_4)
nodes = Point(cullpt.Points)

# ---- group: create network
createnetwork = GhPythonScript(nodes=nodes, map=map, curves=simplify.Curve, intermediate_data=splitcrvs.A)  # -> Network; inputs nodes: list of Point3d, map: list of Int32, curves: list of Curve, intermediate_data: list
# ---------- createnetwork: Python ----------
"""Make JSON data
    Inputs:
        x: The x script variable
        intermediate_data: intermediate_data
    Output:
        Network: Road Network as JSON data"""

__author__ = "Atlas"
__version__ = "2023.07.16"

import rhinoscriptsyntax as rs
import ghpythonlib.components as ghc
import Rhino.Geometry as rg
import json


def pt(point):
    return (point[0], point[1])

##############
output_nodes = []
for node in nodes:
    output_nodes.append({
        'x':round(node[0]),
        'y':round(node[1]),
        'z':round(node[2]),
        })
##############

##############
output_roads = []
i = 0
for curve, attribute in zip(curves, intermediate_data):
    if isinstance(curve, rg.LineCurve):
        #print('line')
        ends = ghc.EndPoints(curve)
        processed_curve = {'crv_type':'Line','n1':pt(ends[0]),'n2':pt(ends[1])}
    elif isinstance(curve, rg.PolylineCurve):
        #print('polyline')
        pts = ghc.ControlPoints(curve)[0]
        processed_curve = {'crv_type':'PolyLine','pts':[pt(p) for p in pts]}
    else:
        print(curve)
        raise Exception('curve type unsupported, only lines and polylines')
        #continue # unsupported curve type
    
    attribute = json.loads(attribute) # intermediate_data contains lanes and maybe name?
    attribute = {'lanes':attribute} ######################### <<<<<<<<<<<<<
    n1 = map[i*2]
    n2 = map[i*2+1]
    attribute['n1'] = n1
    attribute['n2'] = n2
    attribute['curve'] = processed_curve
    attribute['trim_start'] = [0,0]
    attribute['trim_end'] = [1,1]
    
    output_roads.append(attribute)
    i += 1
##############

info = {
    'node_count':len(output_nodes),
    'road_count':len(output_roads),
    'properties':[]
}

Network = json.dumps({
    'info':info,
    'nodes':output_nodes, 
    'roads':output_roads,
    'markers':[],
    'vehicles':[],
})
# ---------- end createnetwork ----------

# ----
network = ClusterOutput(createnetwork)

# ==== cluster Spawner: Create a vehicle spawner. Its outputput should be fed into the AddMarkers component.
road_index = ClusterInput()
spacing = ClusterInput()
spawns_remaining = ClusterInput()
target = ClusterInput()
lane_indices = ClusterInput()
t = ClusterInput()
spawner = GhPythonScript(road_index=road_index, lane_indices=lane_indices, t=t, spacing=spacing, spawns_remaining=spawns_remaining, target=target)  # -> M; inputs road_index: Int32, lane_indices: list of Int32, spawns_remaining: Int32, target: Int32
# ---------- spawner: Python ----------
"""Provides a scripting component.
    Inputs:
        road_index: 
        lane_indices: 
    Output:
        M: Marker data"""

__author__ = "Atlas"
__version__ = "2023.08.03"

import rhinoscriptsyntax as rs
import json

def get(val, default):
    if val is not None:
        return val
    return default

def add(key, val):
    if val is not None:
        marker[key] = val

if road_index is None:
    raise Exception('Set road index to an integer')
if road_index < 0:
    raise Exception('Road index must be equal or greater than 0')

if target is None:
    marker = {'type':'spawner', 'road_index':int(road_index)} # required setup
else:
    marker = {'type':'spawner', 'road_index':int(road_index), 'target':(target, None)} # required setup

if lane_indices:
    marker['lane_indices'] = lane_indices

add('t', t)
add('spacing', spacing)
add('spawns_remaining', spawns_remaining)

print(marker)
M = json.dumps(marker)

"""
marker['road_index'], 
marker.get('lane_indices', [0]),
marker.get('t', 0),
marker.get('spacing', 10),
marker.get('spawns_remaining', 100),
marker.get('target', None),"""
# ---------- end spawner ----------
M = ClusterOutput(spawner)
